# Grasshopper definition SHELL.gh (Grasshopper 1.0.7)

number_slider = Slider(15, range=0..100)
point = GetInteger(Slider(5, range=0..100), AtLeast=1, AtMost=1, Maximum=2147483647, Minimum=-2147483648)
distance = GetInteger(Slider(5, range=0..100), AtLeast=1, AtMost=1, Maximum=2147483647, Minimum=-2147483648)
width = GetInteger(number_slider, AtLeast=1, AtMost=1, Maximum=2147483647, Minimum=-2147483648)
height = GetInteger(Slider(4, range=0..10), AtLeast=1, AtMost=1, Maximum=2147483647, Minimum=-2147483648)

range = Range(Domain=point, Steps=distance)
lng = ListLength(List=range)
sin = Sine(Value=range)
multiplication = Multiplication(A=sin, B=height)
pt = ConstructPoint(XCoordinate=0, YCoordinate=range, ZCoordinate=multiplication)
intcrv = Interpolate(Vertices=pt, Degree=3, Periodic=False, KnotStyle=1)  # -> Curve, Length, Domain
xy = XYPlane(Origin=Point(0, 0, 0))
mirror = Mirror(Geometry=intcrv.Curve, Plane=xy)  # -> Geometry, Transform
X = UnitX(Factor=number_slider)
move = Move(Geometry=mirror.Geometry, Motion=X)  # -> Geometry, Transform
divide = DivideCurve(Curve=intcrv.Curve, Count=lng, Kinks=False)  # -> Points, Tangents, Parameters
divide_2 = DivideCurve(Curve=move.Geometry, Count=lng, Kinks=False)  # -> Points, Tangents, Parameters
ln = Line(StartPoint=divide_2.Points, EndPoint=divide.Points)
loft = Loft(Curves=ln, Options={Adjust=False, Closed=False, LoftEnds=0, LoftSimp=0, LoftType=0, Rebuild=10, Refit=0.01})

# ---- group: RH_OUT:myBox
mesh = Mesh(loft)
